# Grasshopper definition yam.gh (Grasshopper 1.0.5)

panel = Panel("C:\\Users\\631\\Documents\\GitHub\\Fermi\\src\\grsshppr_gunix.py")
list = ValueList({"dir", "file"}, selected="file")
bibil = PythonScript(dir=[panel, "C:\\saeran\\master\\git\\Fermi\\src\\grsshppr_gunix.py"], type=list)  # -> file; inputs dir: list
# ---------- bibil: Python ----------
import os
import sys

ghenv.Component.Params.Output[0].Name = "null"
ghenv.Component.Params.Output[0].NickName = "null"

#sys.path.append("C:\Program Files\Rhinoceros 5.0 (64-bit)\System")


confirm_dir = None
for d in dir:
    try:
        if type == "file":
            file_ = open(d)
            file_.close()
        else:
            print os.listdir(d)
        confirm_dir = d
        break
    except Exception as e:
        #print str(e)
        continue
if confirm_dir != None:
    ghenv.Component.Params.Output[0].Name = type
    ghenv.Component.Params.Output[0].NickName = type
    dir = confirm_dir
    file = confirm_dir
# ---------- end bibil ----------
panel_2 = Panel("cd ~\Documents\Github\Fermi")
panel_3 = Panel("%load src/loadenv.py")
file = ReadFile(File=bibil, PerLineParse=False)
python = PythonScript(Code=file, Fpath=bibil, Argstr="honeybee obj", Launch=Button())  # -> TestSomeStuff, ThisCouldBeAThing, More, YoDude
